# Grasshopper definition hysteresis2.0.ghx (Grasshopper 0.9.76)
# plug-ins: Python Interpreter, Human UI, Flux

index = ControlKnob(Decimals=0, Limit=False, Maximum=10, Minimum=0, Range=10, Value=363)
record = Button()
reset = Button()

param01 = Slider(14, range=0..20)
param02 = Slider(7, range=0..10)

param06 = Slider(7, range=0..10)
param04 = Slider(10, range=0..20)

# ---- group: Connection
param03 = Slider(2, range=0..10)

# ---- group: Meshing
param07 = Slider(2, range=0..10)
param09 = Slider(0, range=0..10)
param08 = Slider(7, range=0..10)

param12 = Slider(3, range=0..10000)
param10 = Slider(0, range=0..10)
param11 = Slider(51, range=0..1000)
param05 = Slider(6, range=0..100)

# ----
new_product = Button()
send_to_gallery = BooleanToggle(False)

which_product = ValueList({"Recorded": "recorded", "Gallery": "gallery"}, selected="Recorded")

doguscan = Doguscan(
    int_2=param01,
    int_4=param02,
    N=param03,
    int_6=param04,
    S=param05,
    int_3=param06,
    L=param07,
    L_2=param08,
    D_2=param09,
    N_2=param10,
    D=param11,
    int=param12)  # -> data_2, O
flux = FluxProject(project="a9jAyvE70YL3qR5WZ")  # -> Keys, Meta
flow_control = FlowControl({"Once", "Constantly"}, selected="Constantly")
to_flux = ToFlux(Keys=flux.Keys, Mode=flow_control, keyId="40e273591a581a702b10445b1567f97b", mode="Constantly")
to_flux_2 = ToFlux(Keys=flux.Keys, Mode=flow_control, keyId="40eb4de7d220ebd98aef0ffb841f45d5", mode="Constantly")
createsnippet = CreateSnippet(run=Button(ExpressionNormal="True", ExpressionPressed="False"))  # -> out, A; inputs run: Boolean
# ---------- createsnippet: C# ----------
    if(!run) return;
    GH_DocumentIO docIO = new GH_DocumentIO(GrasshopperDocument);
    List<Guid> objectsToCopy = new List<Guid>();
    foreach(IGH_DocumentObject obj in GrasshopperDocument.Objects){ //for all objs in GH doc
      if(obj is Grasshopper.Kernel.Special.GH_Group){ //if it's a group
        Grasshopper.Kernel.Special.GH_Group grp = obj as Grasshopper.Kernel.Special.GH_Group;
        if(grp.Objects().Exists(x => x.InstanceGuid == this.Component.InstanceGuid)){ //if the group contains this script
          foreach(IGH_DocumentObject grpObj in grp.Objects()){ // for all the objects in the group
            if(grpObj.InstanceGuid != this.Component.InstanceGuid){ // if the object isn't this component
              //save the guid of the objects to copy
              objectsToCopy.Add(grpObj.InstanceGuid);
            }
          }
        }

      }
    }

    //create a binary representation of the objects from the group by copying them and serializing the XML from the clipboard
    docIO.Copy(GH_ClipboardType.System, objectsToCopy);
    string snippet = System.Windows.Forms.Clipboard.GetText();
    docIO.ClearClipboard(GH_ClipboardType.System);

    string locked = "<item name=\"Locked\" type_name=\"gh_bool\" type_code=\"1\">true</item>";
    string unlocked = "<item name=\"Locked\" type_name=\"gh_bool\" type_code=\"1\">false</item>";
    // string locked = @"" < item name = "Locked" type_name = "gh_bool" type_code = "1" > true</item > "";
    // string unlocked = @"" < item name = "Locked" type_name = "gh_bool" type_code = "1" > false</item > "";

    snippet = snippet.Replace(locked, unlocked);
    A = snippet;
# ---------- end createsnippet ----------

geo = Geometry(doguscan.O)

flow_control_2 = FlowControl({"Once", "Constantly"}, selected="Constantly")
flux_2 = FluxProject(project="a9jAyvE70YL3qR5WZ")  # -> Keys, Meta
to_flux_3 = ToFlux(
    Keys=flux_2.Keys,
    Value=createsnippet.A,
    Mode=flow_control_2,
    keyId="40125174d928b38689aec28fc8e6e8ed",
    mode="Constantly")
from_flux = FromFlux(
    Keys=flux_2.Keys,
    Mode=flow_control_2,
    keyId="40eb4de7d220ebd98aef0ffb841f45d5",
    mode="Constantly",
    Branch0_Path="{0;0;0;0;0;0}",
    Branch0_Item0_TypeName="Grasshopper.Kernel.Types.GH_Mesh")  # -> Value, Meta
move = Move(Geometry=from_flux.Value, Motion=Vector(122, 0, 0))  # -> Geometry, Transform

number_slider = Slider(652, range=500..1000)
number_slider_2 = Slider(776, range=500..1000)

getguid = PythonScript(comp=move.Geometry)  # -> out, out_guid
# ---------- getguid: Python ----------
for input in ghenv.Component.Params.Input:
    for source in input.Sources:
        if str(source.Type) == "Grasshopper.Kernel.Types.IGH_GeometricGoo":
            out_guid = str(source.InstanceGuid)
# ---------- end getguid ----------
item = CherryPicker(getguid.out_guid, ListIndex=0)
panel = Panel(item)

gridtype = Slider(4, range=0..4)
outputshape_seg = Slider(3, range=3..8)
outputshape = Slider(0, range=0..1)
pointy = Slider(0.6, range=0..1)
attf_x = Slider(0, range=0..2)
scale = Slider(1, range=1..15)
pointx = Slider(0.8, range=0..1)
angle = Slider(0, range=0..100)
reactorgen = ReactorGen(G=gridtype, G_2=attf_x, G_3=outputshape, S=outputshape_seg, A=pointx, A_2=pointy, B=scale, A_3=angle)  # disabled
geo_2 = Geometry(reactorgen)

window = LaunchWindow(Show=Toggle(True), Name="Compare", Width=370, Height=400, ChildStatus=1)
text = CreateTextBox(Label="Cartesian Product from", DefaultText=which_product, UpdateButton=True)

getdirectory = PythonScript()  # -> dir, file_name, full_path
# ---------- getdirectory: Python ----------
import os
fn = ghenv.Component.OnPingDocument()
file_name = (str(fn)).strip("*")
print file_name

full_path = (ghenv.Component.OnPingDocument().FilePath)

dir = full_path.replace(file_name+".ghx","")
print dir
print full_path
# ---------- end getdirectory ----------
c_script = CSharpScript(Cluster="Doguscan", Output="output")  # -> out, Data; inputs Cluster: String, Output: String
# ---------- c_script: C# ----------
    RegisterSolutionStartEvent();

    IGH_Param parameter = FindParameter(Cluster, Output);
    if (parameter == null)
    {
      Print("No such cluster+parameter could be found");
      return;
    }

    Data = HarvestData(parameter);
# ---------- c_script: C# additional code ----------
  private bool _registered = false;

  private void RegisterSolutionStartEvent()
  {
    if (_registered)
      return;

    _registered = true;
    GrasshopperDocument.SolutionStart += Document_SolutionStart;
  }

  private void Document_SolutionStart(object sender, EventArgs e)
  {
    // TODO: figure out whether the cluster we're supposed to be watching
    //       has expired. If so, then we need to expire this component as well.
    
    Component.ExpireSolution(false);
  }
  private IGH_Param FindParameter(string clusterName, string outputName)
  {
    // Iterate over all objects in the document.
    foreach (IGH_DocumentObject obj in GrasshopperDocument.Objects)
    {
      // Make sure nickname matches.
      if (!string.Equals(clusterName, obj.NickName, StringComparison.Ordinal))
        continue;

      // Make sure object is a cluster.
      Grasshopper.Kernel.Special.GH_Cluster cluster = obj as Grasshopper.Kernel.Special.GH_Cluster;
      if (obj == null)
        continue;

      // Iterate over all output parameters.
      foreach (IGH_Param output in cluster.Params.Output)
        if (string.Equals(output.NickName, outputName, StringComparison.Ordinal))
          return output;
    }

    return null;
  }
  private DataTree<object> HarvestData(IGH_Param parameter)
  {
    // Make sure the cluster has been solved.
    Grasshopper.Kernel.Special.GH_Cluster cluster =
      parameter.Attributes.Parent.DocObject as Grasshopper.Kernel.Special.GH_Cluster;
    if (cluster == null)
      return null;

    if (cluster.Phase != GH_SolutionPhase.Computed)
    {
      cluster.CollectData();
      cluster.ComputeData();
    }

    IGH_Structure tree = parameter.VolatileData;
    if (tree == null)
    {
      Print("Parameter contains no data.");
      return null;
    }

    DataTree<object> newTree = new DataTree<object>();
    newTree.MergeStructure(tree, null);
    return newTree;
  }
# ---------- end c_script ----------
datafile = PythonScript(path=getdirectory.dir)  # -> datafile
# ---------- datafile: Python ----------
import os
datafile = os.path.join(path, "data.dat")
print datafile
# ---------- end datafile ----------
restorefile = PythonScript(path=getdirectory.dir)  # -> restorefile
# ---------- restorefile: Python ----------
import os

pardir = os.path.abspath(os.path.join(path, os.pardir))

restorefile = os.path.join(pardir, "received"+os.path.sep+"restore.json")
print path
print pardir
print restorefile
# ---------- end restorefile ----------
file = ReadFile(File=restorefile, PerLineParse=False)
file_2 = ReadFile(F=datafile, PerLineParse=True)  # -> C
#   port F: Uri of file to read
# ---------- file_2: VB line parser ----------
    action = GH_LineParserAction.Include
    Return line

    'Parse the line and return some data that represents the line.
    'If the line cannot be parsed, you can return Nothing and
    'assign a different action.
    'The default implementation is to just return the line itself.
    'If you return types that implement IGH_Goo, this component
    'will work substantially faster.
# ---------- end file_2 ----------
restore_state = PythonScript(file=file, node_name="Doguscan")
# ---------- restore_state: Python ----------
import json
state = json.loads(file)
print state

ghObjects = ghenv.Component.OnPingDocument().Objects
for obj in ghObjects:
    if obj.NickName == node_name:
        for input in obj.Params.Input:
            value = state['params'][input.NickName]
            input.Sources[0].Slider.Value = value
        obj.ExpireSolution(True)
# ---------- end restore_state ----------
magicbox = PythonScript(node_name="Doguscan", data=simplify(file_2), index=index)  # -> matrix, keys, index, a; inputs data: list
# ---------- magicbox: Python ----------
import json
import cPickle
import itertools
import Grasshopper as gh
from System import Guid
from scriptcontext import doc
import os
import time

keylist = []
valuelist = []

#def chunks(l, n):
#    """Yield successive n-sized chunks from l."""
#    for i in xrange(0, len(l), n):
#        yield l[i:i+n]
#        
#def get_node(name):
#    ghObjects = ghenv.Component.OnPingDocument().Objects
#    for obj in ghObjects:
#        if obj.NickName == name:
#            return obj
#    print "Node not found"
def create_flipdict(data):
    veclist = []
    # turn strings into dicts
    for item in data:
        alt = json.loads(item)
        veclist.append(alt["params"])
    flipdict = dict()    
    # get the names of keys to iterate over 
    for vec in veclist:   
        for key in vec:
            flipdict[key] = []
    
    #accumulate
    for key in flipdict:
        for vec in veclist:
            if key in vec:
                flipdict[key].append(vec[key])
    return flipdict                

def create_matrix(flipdict):
        
    #create matrix 
    matrix = []       
    for key in flipdict:
        matrix.append(list(set(flipdict[key])))
        keylist.append(key)
    return matrix

#def generate_cproduct(matrix):
#    #cartesian product
#    product = []
#    for item in itertools.product(*matrix):
#        product.append(item)
#    return product
#
#def get_alt(index, productlist,flipdict):
#    i = int(index)%(len(productlist)) 
#    selection = productlist[i]    
#    rvec = dict()    
#    nkeylist = []
#    for key in flipdict:
#        nkeylist.append(key)
#    for key,value in zip(nkeylist,selection):
#        rvec[key] = value
#    return rvec
#
#def update_model(rvec, node):
#    for input in node.Params.Input:
#        value = rvec[input.NickName]
#        input.Sources[0].Slider.Value = value
#    node.ExpireSolution(True)
#    print "Updated "+node.NickName


# Generate cartesian product from Rhino/GH input 
# and send to gallery on click
#node = get_node(node_name)
flipdict = create_flipdict(data)
matrix = create_matrix(flipdict)
#cproduct = generate_cproduct(matrix)
#_alt = get_alt(index, cproduct, flipdict)
#repeater = get_node("2"+node_name)
#update_model(_alt,repeater)
#alt=json.dumps(_alt)
#_matrix = json.dumps(matrix)
_matrix = matrix
keys = keylist
a = json.dumps(flipdict)
print a
#cPickle.dumps(keylist)
# ---------- end magicbox ----------
data_grabber = PythonScript(node_name="Doguscan", path=datafile, output_data=c_script.Data, record=record, reset=reset)  # inputs output_data: list, record: Boolean
# ---------- data_grabber: Python ----------
import Grasshopper as gh
import os
import json
#path1 = os.path.dirname(path)
#print path1
#path.replace("public\","data.dat")
print path
ghObjects = ghenv.Component.OnPingDocument().Objects
d = dict()
d["Output"] = {}
d["params"] = {}
key_list = []
if record:
    for obj in ghObjects:
        if obj.NickName == node_name.ToString():
            value_list = []
            for input in obj.Params.Input:
                if input.Sources[0].NickName:
                    key = input.Sources[0].NickName
                else:
                    input.Sources[0].NickName = input.NickName
                    key = input.Sources[0].NickName
                value = input.Sources[0].Slider.Value.ToDouble(input.Sources[0].Slider.Value)
                d["params"][key] = value
                value_list.append(value)
    for i in range(0,len(output_data),2):
        d["Output"][str(output_data[i])]= output_data[i+1]
    if len(d)>0:
#        d_vector = value_list
        print d
        if os.path.exists(path):
            with open(path, 'a') as outfile:
                json.dump(d, outfile)            
            f = open(path,'a')
            f.write('\n')
        else:
            with open(path, 'w') as outfile:
                json.dump(d, outfile)
            f = open(path,'a')
            f.write('\n')
        f.close()
 
if reset:
    f = open(path,'w')
    f.write('')
    f.close()
        
#for obj in ghObjects:
#    if obj.NickName == node_name.ToString():
#        value_list = []
#        for input in obj.Params.Input:
#            key_list.append(input.NickName)
#
#length = int(len(key_list))
# ---------- end data_grabber ----------
flow_control_3 = FlowControl({"Once", "Constantly"}, selected="Constantly")
flux_3 = FluxProject(project="a9jAyvE70YL3qR5WZ")  # -> Keys, Meta
serialize = PythonScript(input=magicbox.keys)  # -> output
# ---------- serialize: Python ----------
import cPickle
output = cPickle.dumps(input)
print output
print(type(output))
# ---------- end serialize ----------
serialize_2 = PythonScript(input=magicbox.matrix)  # -> output; same code as serialize
serialize_3 = PythonScript(input="Doguscan")  # -> output; same code as serialize
from_flux_2 = FromFlux(
    Keys=flux_3.Keys,
    Mode=flow_control_3,
    keyId="408642bb36ad94d34f040012d21f4c92",
    mode="Constantly",
    Branch0_Path="{0;0;0;0}",
    Branch0_Item0_null_string=False,
    Branch0_Item0_string="""(dp0
Vparam08
p1
F7.0
sVparam09
p2
F6.0
sVparam12
p3
F3.0
sVparam02
p4
F6.0
sVparam03
p5
F2.0
sVparam10
p6
F0.0
sVparam01
p7
F14.0
sVparam06
p8
F6.0
sVparam07
p9
F2.0
sVparam04
p10
F10.0
sVparam05
p11
F6.0
sVparam11
p12
F20.0
s.""",
    Branch0_Item0_TypeName="Grasshopper.Kernel.Types.GH_String")  # -> Value, Meta
kernel2product = PythonScript(
    node_name="Doguscan",
    dir=getdirectory.dir,
    full_path=getdirectory.full_path,
    trigger=new_product,
    currentModel=magicbox.a)  # -> a
# ---------- kernel2product: Python ----------
import json
import itertools
import Grasshopper as gh
from System import Guid
from scriptcontext import doc
import os
import time
import Rhino
import rhinoscriptsyntax as rs
import cPickle

gh = Rhino.RhinoApp.GetPlugInObject("Grasshopper")

rs.EnableRedraw(True)

pardir = os.path.abspath(os.path.join(dir, os.pardir))
path = os.path.join(pardir,"gallery"+os.sep)
print path
pardir2 = os.path.abspath(os.path.join(path, os.pardir))
path_kernel = os.path.join(pardir2, "received"+os.path.sep)
print path_kernel
keylist = []
valuelist = []
RhinoDocument = Rhino.RhinoDoc.ActiveDoc
view = RhinoDocument.Views.Find('kernel', False)
print view


#
#def chunks(l, n):
#    """Yield successive n-sized chunks from l."""
#    for i in xrange(0, len(l), n):
#        yield l[i:i+n]
#
def create_flipdict(data):
    veclist = []
    # turn strings into dicts
    for item in data:
        vec = eval(item)
        veclist.append(vec)
    
    flipdict = dict()    
    # get the names of keys to iterate over 
    for vec in veclist:   
        for key in vec:
            flipdict[key] = []
    
    #accumulate
    for key in flipdict:
        for vec in veclist:
            if key in vec:
                flipdict[key].append(vec[key])
    return flipdict                

def create_matrix(flipdict):
        
    #create matrix 
    matrix = []       
    for key in flipdict:
        matrix.append(set(flipdict[key]))
    return matrix

def generate_cproduct(matrix):
    #cartesian product
    product = []
    for item in itertools.product(*matrix):
        product.append(item)
    return product

def get_alt(index, productlist,flipdict):
    i = int(index)%(len(productlist)) 
    selection = productlist[i]    
    rvec = dict()    
    nkeylist = []
    for key in flipdict:
        nkeylist.append(key)
    for key,value in zip(nkeylist,selection):
        rvec[key] = value
    return rvec

def update_model(rvec, node):
    for input in node.Params.Input:
        value = rvec[input.NickName]
        input.Sources[0].Slider.Value = value
    node.ExpireSolution(False)
    print "Updated "+node.NickName
    
def get_node(name):
    ghObjects = ghenv.Component.OnPingDocument().Objects
    for obj in ghObjects:
        if obj.NickName == name:
            return obj
    print "Node not found"
def captureView(uid):
    bmp = view.CaptureToBitmap(False, False, False)
    bmp.Save(path+uid+".bmp")       

def send_to_gallery(data,send):
    if send:
        json_data = dict()
    
        uid = str(Guid.NewGuid())
        json_data['params'] = data
        json_data['uid'] = uid
        json_data['cad_file'] = 'xyz.obj'
        json_data['image'] = uid+'.bmp'
        captureView(uid)
#        bitmap = doc.Views.ActiveView.CaptureToBitmap(True, True, True)
#        bitmap.Save(path+uid+'.bmp')
        with open(path+uid+'.json','w') as outfile:
            json.dump(json_data, outfile, indent=2)
        print "Sent "+uid+" to gallery"  
        baked = gh.BakeDataInObject(comp_guid)





# Generate cart. prod. from new kernel and slowly send to gallery
node = get_node(node_name)
# Read file
if os.path.exists(path_kernel+'kernel.json'):
    f = open(path_kernel+'kernel.json','r')
    data = f.read()
    f.close()
    if len(data)>0:
# Fill in missing params
        _currModel = json.loads(currentModel)
        _data = json.loads(data)
        
        for key in _currModel:
            if len(_data[key])<1:
                _data[key]+=_currModel[key]
        a = json.dumps(_data)
        
        print data, "\n"
        print _currModel, "\n"
        print a

# IGNORE THIS SHIT        
        # parse the data into dict
#        kernel = eval(data)
#       erase the file contents to prevent infinite loop
#       f = open(path_kernel+'kernel.json','w')
#       f.write('')
#       f.close()
            
#        _matrix = create_matrix(kernel)
#        a = _matrix
#            _cproduct = generate_cproduct(_matrix)
#            
#            #now iterate over _cproduct and update model
#            #then wait for 1 sec and take snapshot, send to gall
#            for i in range(0,3,1):
#                _alt = get_alt(i , _cproduct, kernel)
#                update_model(_alt,node)
#                time.sleep(1)
#                gh.RunSolver(full_path)
#                time.sleep(1)
#                send_to_gallery(_alt, True)
# ---------- end kernel2product ----------
serialize_4 = PythonScript(input=kernel2product)  # -> output; same code as serialize
to_flux_4 = ToFlux(Keys=flux_3.Keys, Value=serialize_3, Mode=flow_control_3, keyId="4082566f6a4c3b9b7b26701fdb4b1c3b", mode="Constantly")
to_flux_5 = ToFlux(Keys=flux_3.Keys, Value=serialize_2, Mode=flow_control_3, keyId="404722a83a22684e0079a179785efa64", mode="Constantly")
to_flux_6 = ToFlux(Keys=flux_3.Keys, Value=serialize, Mode=flow_control_3, keyId="40fc6dc0a9c8f0442f6624b91b6640f1", mode="Constantly")
to_flux_7 = ToFlux(Keys=flux_3.Keys, Value=magicbox.index, Mode=flow_control_3, keyId="40b8bce9d56129e52fe444d295fc9af4", mode="Constantly")

flow_control_4 = FlowControl({"Once", "Constantly"}, selected="Constantly")
deserialize2list = PythonScript(input=from_flux_2.Value)  # -> keyList, valueList, output
# ---------- deserialize2list: Python ----------
import cPickle
dict = cPickle.loads(input)
keyList = []
valueList = []
for key in dict:
    keyList.append(key)
    valueList.append(dict[key])
#output = "Parameter values :\n" + str(cPickle.loads(input))
print output
print(type(output))
print keyList, valueList
# ---------- end deserialize2list ----------
to_flux_8 = ToFlux(Keys=flux_3.Keys, Value=which_product, Mode=flow_control_3, keyId="4006faa082ee097903a6e99e6db4516a", mode="Constantly")
from_flux_3 = FromFlux(
    Keys=flux_3.Keys,
    Mode=flow_control_3,
    keyId="40e273591a581a702b10445b1567f97b",
    mode="Constantly",
    Branch0_Path="{0}",
    Branch0_Item0_null_string=False,
    Branch0_Item0_string="Top_points",
    Branch0_Item0_TypeName="Grasshopper.Kernel.Types.GH_String",
    Branch0_Item1_number=3,
    Branch0_Item1_TypeName="Grasshopper.Kernel.Types.GH_Integer",
    Branch0_Item2_null_string=False,
    Branch0_Item2_string="curves",
    Branch0_Item2_TypeName="Grasshopper.Kernel.Types.GH_String",
    Branch0_Item3_number=11,
    Branch0_Item3_TypeName="Grasshopper.Kernel.Types.GH_Integer")  # -> Value, Meta

python = PythonScript(in_data=from_flux_3.Value)  # -> name, value; inputs in_data: tree
# ---------- python: Python ----------
name = []
value = []
l = in_data.Branch(0)

for i in range(0,len(l),2):
    name.append(l[i])
    value.append(l[i+1])
# ---------- end python ----------

multichart = CreateMultiChart(
    Data=deserialize2list.valueList,
    Names=deserialize2list.keyList,
    Title="Input params",
    ClusterTitle="Input param values of selected result",
    ChartType=0)
multichart_2 = CreateMultiChart(Data=python.value, Names=python.name, Title="Outputs", ClusterTitle="Input param values of selected result", ChartType=0)

addelems = AddElements(Window=window, Elements=flatten([multichart, multichart_2, text]))  # -> AddedElements, ElementNames
adjustpos = AdjustElementPositioning(ElementsToAdjust=multichart, AbsolutePositioning=False, Width=number_slider_2, Height=number_slider_2)
adjustpos_2 = AdjustElementPositioning(ElementsToAdjust=multichart_2, AbsolutePositioning=False, Width=number_slider, Height=number_slider)

to_flux_9 = ToFlux(Keys=flux_3.Keys, Value=serialize_4, Mode=flow_control_4, keyId="403b08d4ea68137ba11c4286c4962062", mode="Constantly")
send_to_gallery_2 = PythonScript(
    alt=from_flux_2.Value,
    dir=getdirectory.dir,
    cad_file=getdirectory.full_path,
    send=send_to_gallery,
    comp_guid=panel,
    output_data=from_flux_3.Value,
    node_name="Doguscan")  # inputs output_data: list
# ---------- send_to_gallery_2: Python ----------
##OBJ SETTINGS##
e_str = "_Geometry=_Mesh "
e_str+= "_EndOfLine=CRLF "
#e_str+= "_ExportRhinoObjectNames=_ExportObjectsAsOBJGroups "
e_str+= "_ExportMeshTextureCoordinates=_Yes "
e_str+= "_ExportMeshVertexNormals=_Yes "
e_str+= "_CreateNGons=_No "
e_str+= "_ExportMaterialDefinitions=_No "
e_str+= "_YUp=_Yes "
e_str+= "_WrapLongLines=Yes "
e_str+= "_VertexWelding=_Welded "
e_str+= "_WritePrecision=4 "
e_str+= "_Enter "
#e_str+= "_DetailedOptions "
#e_str+= "_JaggedSeams=_No "
#e_str+= "_PackTextures=_No "
#e_str+= "_Refine=_Yes "
#e_str+= "_SimplePlane=_No "
#e_str+= "_AdvancedOptions "
#e_str+= "_Angle=50 "
#e_str+= "_AspectRatio=0 "
#e_str+= "_Distance=0.0"
#e_str+= "_Density=0 "
#e_str+= "_Density=0.45 "
#e_str+= "_Grid=0 "
#e_str+= "_MaxEdgeLength=0 "
#e_str+= "_MinEdgeLength=0.0001 "
e_str+= "_Enter _Enter"
## OBJ SETTING


from System import Guid
import cPickle
import json
from scriptcontext import doc
import rhinoscriptsyntax as rs
import os
import System.Drawing
import Rhino
pardir = os.path.abspath(os.path.join(dir, os.pardir))
path = os.path.join(pardir,"gallery"+os.sep)
print path
print output_data
alt = cPickle.loads(alt)
normalized_path = os.path.abspath(cad_file).ToString()
print normalized_path
#_alt = json.loads(alt)
RhinoDocument = Rhino.RhinoDoc.ActiveDoc
view = RhinoDocument.Views.Find('product', False)
print view
print comp_guid
gh = Rhino.RhinoApp.GetPlugInObject("Grasshopper")


def captureView(uid):
    bmp = view.CaptureToBitmap(False, False, False)
    bmp.Save(path+uid+".bmp")

#def rCommonCap(viewportName,scaleFactor):
#    RhinoDocument = Rhino.RhinoDoc.ActiveDoc
#    view = RhinoDocument.Views.Find('product', False)
##    vp = view.ActiveViewport
##    size = System.Drawing.Size(vp.Size.Width*scaleFactor,vp.Size.Height*scaleFactor)
#    capture = view.CaptureToBitmap(True, True, True)
#    return capture

def send_to_gallery(data):
    uid = str(Guid.NewGuid())
    captureView(uid)
    
    baked = gh.BakeDataInObject(comp_guid)

    cad_file_name = uid + ".stl"
    rs.Command("_SelNone", True)
    rs.Command("_SelLast", True)
    command = '-_Export "{}{}{}" {}'.format(path, uid, "."+"obj", e_str)
    rs.Command(command, True)
    rs.Command("_SelLast", True)
    rs.Command("_Delete", True)
    rs.Command("_SelNone", True)    
    
    json_data = dict()
    json_data["filepath"] = normalized_path
    json_data["params"] = data
    json_data["uid"] = uid
    json_data["cad_file"] = uid+'.obj'
    json_data["image"] = uid+'.bmp'   
    json_data["Output"] = {}
    json_data["model_name"] = node_name
    for i in range(0,len(output_data),2):
        json_data["Output"][output_data[i]] = output_data[i+1]
    print json_data
    with open(path+uid+'.json','w') as outfile:
        json.dump(json_data, outfile, indent=2)
    

    print "Sent "+uid+" to gallery"
print alt    
if send:
    send = False
    send_to_gallery(alt)
# ---------- end send_to_gallery_2 ----------

# ==== cluster ReactorGen
A = ClusterInput()
A_2 = ClusterInput()
sqgrid = Square(Plane=PlaneXY(0, 0, 0), Size=10, ExtentX=10, ExtentY=10)  # -> Cells, Points
trigrid = Triangular(Plane=PlaneXY(0, 0, 0), Size=10, ExtentX=20, ExtentY=12)  # -> Cells, Points
hexgrid = Hexagonal(Plane=PlaneXY(0, 0, 0), Size=8, ExtentX=10, ExtentY=8)  # -> Cells, Points
radgrid = Radial(Plane=PlaneXY(50, 50, 0), Size=5, ExtentR=10, ExtentP=20)  # -> Cells, Points
pop2d = Populate2D(Region={Plane=PlaneXY(0, 0, 0), Size=Domain2(u=0..100, v=0..100)}, Count=100, Seed=1)
G = ClusterInput()
scaleup = Multiplication(A=A, B=100)
scaleup_2 = Multiplication(A=A_2, B=100)
pt = ConstructPoint(XCoordinate=scaleup, YCoordinate=scaleup_2, ZCoordinate=0)
gridtype = StreamFilter(Gate=G, Stream0=pop2d, Stream1=radgrid.Points, Stream2=trigrid.Points, Stream3=hexgrid.Points, Stream4=sqgrid.Points)
pt_2 = Point(pt)
G_2 = ClusterInput()
linept_grid = Line(StartPoint=gridtype, EndPoint=pt_2)
f_x_chooser = StreamFilter(Gate=G_2, Stream0="x/2", Stream1="x", Stream2="x*sin(x)")
len = Length(Curve=linept_grid)
B = ClusterInput()
eval = Evaluate(F=f_x_chooser, x=len)
scaledown = Division(A=eval, B=B)
A_3 = ClusterInput()
G_3 = ClusterInput()
outputtype = StreamGate(Stream=gridtype, Gate=G_3)  # -> Target0, Target1
S = ClusterInput()
circle = CircleCNR(Center=outputtype.Target0, Normal=Vector(0, 0, 1), Radius=scaledown)
polygon = Polygon(Plane=outputtype.Target1, Radius=scaledown, Segments=S, FilletRadius=0)  # -> Polygon, Length
rotate = Rotate(Geometry=polygon.Polygon, Angle=A_3, Plane=outputtype.Target1)  # -> Geometry, Transform
merge = Merge(Data1=circle, Data2=rotate.Geometry)
R = ClusterOutput(merge)

# ==== cluster Doguscan
int = ClusterInput()
int_2 = ClusterInput()
int_3 = ClusterInput()
int_4 = ClusterInput()
int_5 = Integer(int)
int_6 = ClusterInput()
int_7 = Integer(int_2)
int_8 = Integer(int_3)
int_9 = Integer(int_4)
int_10 = Integer(int_6)
_2nd_level_base_point_of_grid = Point(<point referenced from the Rhino model>)

# ---- group: Parameter driven by external intervention
chosen_line_heights_list_for_each_line = Number([30, 40])
chosen_points_s_indices_for_line_creatio = Number([2, 10])  # "Chosen points's indices for line creation"
panel = Panel(chosen_line_heights_list_for_each_line)
panel_2 = Panel(chosen_points_s_indices_for_line_creatio)

chosen_points_s_indices_for_line_creatio_2 = Number([2, 12, 15])  # "Chosen points's indices for line creation"
chosen_line_heights_for_each_line = Number([30, 40])
panel_3 = Panel(chosen_points_s_indices_for_line_creatio_2)
panel_4 = Panel(chosen_line_heights_for_each_line)

# ----
base_point_of_grid = Point(<point referenced from the Rhino model>)

# ---- group: Parameter to be modified by processing and structural analysis
displacement_from_original_position_in_z = Number([-5, 5])  # "Displacement from original position in Z axis"
displacement_from_original_position_in_y = Number([-5, 3])  # "Displacement from original position in Y axis"
displacement_from_original_position_in_x = Number([-3, 3])  # "Displacement from original position in X axis"
panel_5 = Panel(displacement_from_original_position_in_z)
panel_6 = Panel(displacement_from_original_position_in_y)
panel_7 = Panel(displacement_from_original_position_in_x)

# ----
vector_xyz = VectorXYZ(XComponent=0, YComponent=0, ZComponent=1)  # -> Vector, Length
rectangle = Rectangle(Plane=PlaneXY(0, 0, 0), XSize=int_7, YSize=int_7, Radius=0)  # -> Rectangle, Length
subtraction = Subtraction(A=int_9, B=1)
vector_xyz_2 = VectorXYZ(XComponent=0, YComponent=0, ZComponent=1)  # -> Vector, Length
rectangle_2 = Rectangle(Plane=PlaneXY(0, 0, 0), XSize=int_10, YSize=int_10, Radius=0)  # -> Rectangle, Length
num = Number(panel_3)
num_2 = Number(panel_2)
subtraction_2 = Subtraction(A=int_8, B=1)
arrrec = RectangularArray(Geometry=base_point_of_grid, Cell=rectangle.Rectangle, XCount=int_9, YCount=int_9)  # -> Geometry, Transform
arrrec_2 = RectangularArray(Geometry=_2nd_level_base_point_of_grid, Cell=rectangle_2.Rectangle, XCount=int_8, YCount=int_8)  # -> Geometry, Transform
amplitude = Amplitude(Vector=vector_xyz_2.Vector, Amplitude=panel_4)  # -> graft(Vector)
amplitude_2 = Amplitude(Vector=vector_xyz.Vector, Amplitude=panel)  # -> graft(Vector)
list_item = ListItem(List=arrrec.Geometry, Index=graft(num), Wrap=False)
list_item_2 = ListItem(List=arrrec_2.Geometry, Index=graft(num_2), Wrap=False)
move = Move(Geometry=list_item, Motion=amplitude)  # -> Geometry, Transform
move_2 = Move(Geometry=list_item_2, Motion=amplitude_2)  # -> Geometry, Transform
vec = VectorXYZ(XComponent=panel_7, YComponent=panel_6, ZComponent=panel_5)  # -> graft(Vector), Length
line = Line(StartPoint=move.Geometry, EndPoint=list_item)
line_2 = Line(StartPoint=move_2.Geometry, EndPoint=list_item_2)
move_3 = Move(Geometry=line_2, Motion=vec.Vector)  # -> Geometry, Transform
end_points = EndPoints(Curve=line)  # -> Start, End
end_points_2 = EndPoints(Curve=move_3.Geometry)  # -> Start, End
bottom_points = Point(flatten(end_points_2.End))
crv = Curve(flatten(move_3.Geometry))
top_points = Point(flatten(end_points.Start))
crv_2 = Curve(flatten(line))
top_points_2 = Point(flatten(end_points_2.Start))
N = ClusterInput()
cps = ClosestPoints(Point=bottom_points, Cloud=top_points, Count=N)  # -> graft(ClosestPoint), CPIndex, Distance
lng = ListLength(List=top_points)
ln = Line(StartPoint=flatten(bottom_points), EndPoint=cps.ClosestPoint)  # -> flatten(Line)
dupln = RemoveDuplicateLines(Lines=ln, Tolerance=0.01)  # -> flatten(UniqueLines)
total_network_of_curves = Curve([dupln, crv, crv_2])
lng_2 = ListLength(List=total_network_of_curves)
crv_3 = Curve(total_network_of_curves)
S = ClusterInput()
N_2 = ClusterInput()
D = ClusterInput()
line_to_mesh = ExoWireframe(Lines=crv_3, Sides=S, StartRadius=int_5, EndRadius=int_5, NodeDepth=N_2, Division=D, Open=False)
data = Data(["Top_points", lng, "curves", lng_2])
L = ClusterInput()
wblaplace = WeaverbirdsLaplacianSmoothing(MeshCurves=line_to_mesh, Level=L, SmoothNakedEdges=1, Thin=1)
D_2 = ClusterInput()
wboffset = WeaverbirdsOffsetMesh(MeshCurves=wblaplace, Distance=D_2, OffsetType=0)
data_2 = ClusterOutput(data)
wbcatmullclark = WeaverbirdsCatmullClarkSubdivision(MeshCurves=wboffset, Level=1, SmoothNakedEdges=1)
L_2 = ClusterInput()
wblaplace_2 = WeaverbirdsLaplacianSmoothing(MeshCurves=wbcatmullclark, Level=L_2, SmoothNakedEdges=1, Thin=1)
O = ClusterOutput(wblaplace_2)
