# Grasshopper definition hysteresis-remote.ghx (Grasshopper 0.9.76)
# plug-ins: Python Interpreter, Flux

outputshape_seg = Slider(8, range=3..8)
gridtype = Slider(1, range=0..4)
pointy = Slider(1, range=0..1)
attf_x = Slider(0, range=0..2)
scale = Slider(6, range=1..15)
outputshape = Slider(1, range=0..1)
pointx = Slider(0.9, range=0..1)
angle = Slider(8, range=0..100)

_2reactorgen = _2ReactorGen(G=gridtype, G_2=attf_x, G_3=outputshape, S=outputshape_seg, A=pointx, A_2=pointy, B=scale, A_3=angle)
geo = Geometry(_2reactorgen)

flux = FluxProject(project="a9jAyvE70YL3qR5WZ")  # -> Keys, Meta
flow_control = FlowControl({"Once", "Constantly"}, selected="Constantly")
to_flux = ToFlux(Keys=flux.Keys, Value=geo, Mode=flow_control, keyId="40cb7ce2f54c0b988a90e04600d8d638", mode="Constantly")
from_flux = FromFlux(
    Keys=flux.Keys,
    Mode=flow_control,
    keyId="404722a83a22684e0079a179785efa64",
    mode="Constantly",
    Branch0_Path="{0;0;0}",
    Branch0_Item0_null_string=False,
    Branch0_Item0_string="""(lp0
F8.0
aF3.0
a.""",
    Branch0_Item0_TypeName="Grasshopper.Kernel.Types.GH_String",
    Branch0_Item1_null_string=False,
    Branch0_Item1_string="""(lp0
F1.0
a.""",
    Branch0_Item1_TypeName="Grasshopper.Kernel.Types.GH_String",
    Branch0_Item2_null_string=False,
    Branch0_Item2_string="""(lp0
F0.90000000000000002
a.""",
    Branch0_Item2_TypeName="Grasshopper.Kernel.Types.GH_String",
    Branch0_Item3_null_string=False,
    Branch0_Item3_string="""(lp0
F1.0
a.""",
    Branch0_Item3_TypeName="Grasshopper.Kernel.Types.GH_String",
    Branch0_Item4_null_string=False,
    Branch0_Item4_string="""(lp0
F1.0
a.""",
    Branch0_Item4_TypeName="Grasshopper.Kernel.Types.GH_String",
    Branch0_Item5_null_string=False,
    Branch0_Item5_string="""(lp0
F8.0
a.""",
    Branch0_Item5_TypeName="Grasshopper.Kernel.Types.GH_String",
    Branch0_Item6_null_string=False,
    Branch0_Item6_string="""(lp0
F0.0
a.""",
    Branch0_Item6_TypeName="Grasshopper.Kernel.Types.GH_String",
    Branch0_Item7_null_string=False,
    Branch0_Item7_string="""(lp0
F6.0
a.""",
    Branch0_Item7_TypeName="Grasshopper.Kernel.Types.GH_String")  # -> Value, Meta
from_flux_2 = FromFlux(
    Keys=flux.Keys,
    Mode=flow_control,
    keyId="40fc6dc0a9c8f0442f6624b91b6640f1",
    mode="Constantly",
    Branch0_Path="{0;0;0}",
    Branch0_Item0_null_string=False,
    Branch0_Item0_string="""VOutputShape-seg
p0
.""",
    Branch0_Item0_TypeName="Grasshopper.Kernel.Types.GH_String",
    Branch0_Item1_null_string=False,
    Branch0_Item1_string="""VOutputShape
p0
.""",
    Branch0_Item1_TypeName="Grasshopper.Kernel.Types.GH_String",
    Branch0_Item2_null_string=False,
    Branch0_Item2_string="""VPointX
p0
.""",
    Branch0_Item2_TypeName="Grasshopper.Kernel.Types.GH_String",
    Branch0_Item3_null_string=False,
    Branch0_Item3_string="""VGridType
p0
.""",
    Branch0_Item3_TypeName="Grasshopper.Kernel.Types.GH_String",
    Branch0_Item4_null_string=False,
    Branch0_Item4_string="""VPointY
p0
.""",
    Branch0_Item4_TypeName="Grasshopper.Kernel.Types.GH_String",
    Branch0_Item5_null_string=False,
    Branch0_Item5_string="""VAngle
p0
.""",
    Branch0_Item5_TypeName="Grasshopper.Kernel.Types.GH_String",
    Branch0_Item6_null_string=False,
    Branch0_Item6_string="""VAttF(x)
p0
.""",
    Branch0_Item6_TypeName="Grasshopper.Kernel.Types.GH_String",
    Branch0_Item7_null_string=False,
    Branch0_Item7_string="""VScale
p0
.""",
    Branch0_Item7_TypeName="Grasshopper.Kernel.Types.GH_String")  # -> Value, Meta
from_flux_3 = FromFlux(
    Keys=flux.Keys,
    Mode=flow_control,
    keyId="40b8bce9d56129e52fe444d295fc9af4",
    mode="Constantly",
    Branch0_Path="{0;0}",
    Branch0_Item0_number=24,
    Branch0_Item0_TypeName="Grasshopper.Kernel.Types.GH_Integer")  # -> Value, Meta
deserialize = PythonScript(input=from_flux.Value)  # -> output
# ---------- deserialize: Python ----------
import cPickle
output = cPickle.loads(input)
print output
print(type(output))
# ---------- end deserialize ----------
deserialize_2 = PythonScript(input=from_flux_2.Value)  # -> output; same code as deserialize
panel = Panel(from_flux_3.Value)
tree2list = PythonScript(intree=deserialize)  # -> outlist; inputs intree: tree
# ---------- tree2list: Python ----------
myList=[]
for i in range(intree.BranchCount):
    arr1 = []
    for j in range(len(intree.Branch(i))):
        arr1.append(intree.Branch(i)[j])
    myList.append(arr1)
    
outlist = myList
print outlist
# ---------- end tree2list ----------
cartesianproduct = PythonScript(kernel=tree2list)  # -> cproduct; inputs kernel: list
# ---------- cartesianproduct: Python ----------
import itertools
import cPickle

def generate_cproduct(matrix):
    #cartesian product
    product = []
    for item in itertools.product(*matrix):
        product.append(item)
    return product

cproduct = generate_cproduct(kernel)
print kernel
# ---------- end cartesianproduct ----------
selector = PythonScript(input=cartesianproduct, keys=deserialize_2, index=from_flux_3.Value)  # -> out, a; inputs input: list, keys: list
# ---------- selector: Python ----------
def get_alt(index, productlist,keys):
    i = int(index)%(len(productlist)) 
    selection = productlist[i]    
    rvec = dict()    
    nkeylist = []
    for key in keys:
        nkeylist.append(key)
    for key,value in zip(nkeylist,selection):
        rvec[key] = value
    return rvec

def update_model(rvec, node):
    for input in node.Params.Input:
        value = rvec[input.NickName]
        input.Sources[0].Slider.Value = value
    node.ExpireSolution(True)
    print "Updated "+node.NickName
    
def get_node(name):
    ghObjects = ghenv.Component.OnPingDocument().Objects
    for obj in ghObjects:
        if obj.NickName == name:
            return obj
    print "Node not found"
    
node = get_node("2ReactorGen")
_alt = get_alt(index, input, keys)
print _alt
update_model(_alt, node)
# ---------- end selector ----------

# ==== cluster _2ReactorGen
A = ClusterInput()
A_2 = ClusterInput()
hexgrid = Hexagonal(Plane=PlaneXY(0, 0, 0), Size=8, ExtentX=10, ExtentY=8)  # -> Cells, Points
sqgrid = Square(Plane=PlaneXY(0, 0, 0), Size=10, ExtentX=10, ExtentY=10)  # -> Cells, Points
trigrid = Triangular(Plane=PlaneXY(0, 0, 0), Size=10, ExtentX=20, ExtentY=12)  # -> Cells, Points
radgrid = Radial(Plane=PlaneXY(50, 50, 0), Size=5, ExtentR=10, ExtentP=20)  # -> Cells, Points
pop2d = Populate2D(Region={Plane=PlaneXY(0, 0, 0), Size=Domain2(u=0..100, v=0..100)}, Count=100, Seed=1)
G = ClusterInput()
scaleup = Multiplication(A=A, B=100)
scaleup_2 = Multiplication(A=A_2, B=100)
pt = ConstructPoint(XCoordinate=scaleup, YCoordinate=scaleup_2, ZCoordinate=0)
gridtype = StreamFilter(Gate=G, Stream0=pop2d, Stream1=radgrid.Points, Stream2=trigrid.Points, Stream3=hexgrid.Points, Stream4=sqgrid.Points)
pt_2 = Point(pt)
linept_grid = Line(StartPoint=gridtype, EndPoint=pt_2)
G_2 = ClusterInput()
f_x_chooser = StreamFilter(Gate=G_2, Stream0="x/2", Stream1="x", Stream2="x*sin(x)")
len = Length(Curve=linept_grid)
B = ClusterInput()
eval = Evaluate(F=f_x_chooser, x=len)
scaledown = Division(A=eval, B=B)
A_3 = ClusterInput()
G_3 = ClusterInput()
outputtype = StreamGate(Stream=gridtype, Gate=G_3)  # -> Target0, Target1
S = ClusterInput()
circle = CircleCNR(Center=outputtype.Target0, Normal=Vector(0, 0, 1), Radius=scaledown)
polygon = Polygon(Plane=outputtype.Target1, Radius=scaledown, Segments=S, FilletRadius=0)  # -> Polygon, Length
rotate = Rotate(Geometry=polygon.Polygon, Angle=A_3, Plane=outputtype.Target1)  # -> Geometry, Transform
merge = Merge(Data1=circle, Data2=rotate.Geometry)
R = ClusterOutput(merge)
