# Grasshopper definition reactor_gh.ghx (Grasshopper 0.9.76)

outputshape_seg = Slider(3, range=3..8)
number_slider = Slider(1, range=0..1)
gridtype = Slider(2, range=0..4)
scale = Slider(10, range=1..15)
number_slider_2 = Slider(1, range=0..1)
attf_x = Slider(1, range=0..2)
number_slider_3 = Slider(45, range=0..100)
outputshape = Slider(0, range=0..1)

reactorgen = ReactorGen(
    G=gridtype,
    G_2=attf_x,
    G_3=outputshape,
    S=outputshape_seg,
    A=number_slider_2,
    A_2=number_slider,
    B=scale,
    A_3=number_slider_3)
geo = Geometry(reactorgen)
params = Merge(
    Data1=gridtype,
    Data2=attf_x,
    Data3=outputshape,
    Data4=outputshape_seg,
    Data5=number_slider_2,
    Data6=number_slider,
    Data7=scale,
    Data8=number_slider_3)
send_to_gallery = Button()
knob = ControlKnob(Decimals=0, Limit=False, Maximum=10, Minimum=0, Range=5, Value=23)
dam = DataDam(DataRECORD=params, BufferDelay=10000000, BufferMode=0)
path = FilePath("C:\School\School\GH\Hysteresis\results\trail.txt")
hysteresiseng = HysteresisEng(data=dam, index=knob, send=send_to_gallery, path=path)  # -> alt, S
sift = SiftPattern(List=hysteresiseng.alt, SiftPattern=hysteresiseng.S)  # -> Output0, Output1, Output2, Output3, Output4, Output5, Output6, Output7

clean = CleanTree(RemoveNulls=True, RemoveInvalid=True, RemoveEmpty=False, Tree=sift.Output0)
clean_2 = CleanTree(RemoveNulls=True, RemoveInvalid=True, RemoveEmpty=False, Tree=sift.Output1)
clean_3 = CleanTree(RemoveNulls=True, RemoveInvalid=True, RemoveEmpty=False, Tree=sift.Output3)
clean_4 = CleanTree(RemoveNulls=True, RemoveInvalid=True, RemoveEmpty=False, Tree=sift.Output2)
clean_5 = CleanTree(RemoveNulls=True, RemoveInvalid=True, RemoveEmpty=False, Tree=sift.Output4)
clean_6 = CleanTree(RemoveNulls=True, RemoveInvalid=True, RemoveEmpty=False, Tree=sift.Output5)
clean_7 = CleanTree(RemoveNulls=True, RemoveInvalid=True, RemoveEmpty=False, Tree=sift.Output6)
clean_8 = CleanTree(RemoveNulls=True, RemoveInvalid=True, RemoveEmpty=False, Tree=sift.Output7)

reactorgen_2 = ReactorGen(G=clean, G_2=clean_2, G_3=clean_4, S=clean_3, A=clean_5, A_2=clean_6, B=clean_7, A_3=clean_8)
move = Move(Geometry=reactorgen_2, Motion=Vector(189, 0, 0))  # -> Geometry, Transform

# ==== cluster ReactorGen
A = ClusterInput()
A_2 = ClusterInput()
hexgrid = Hexagonal(Plane=PlaneXY(0, 0, 0), Size=8, ExtentX=10, ExtentY=8)  # -> Cells, Points
sqgrid = Square(Plane=PlaneXY(0, 0, 0), Size=10, ExtentX=10, ExtentY=10)  # -> Cells, Points
radgrid = Radial(Plane=PlaneXY(50, 50, 0), Size=5, ExtentR=10, ExtentP=20)  # -> Cells, Points
trigrid = Triangular(Plane=PlaneXY(0, 0, 0), Size=10, ExtentX=20, ExtentY=12)  # -> Cells, Points
pop2d = Populate2D(Region={Plane=PlaneXY(0, 0, 0), Size=Domain2(u=0..100, v=0..100)}, Count=100, Seed=1)
G = ClusterInput()
scaleup = Multiplication(A=A, B=100)
scaleup_2 = Multiplication(A=A_2, B=100)
pt = ConstructPoint(XCoordinate=scaleup, YCoordinate=scaleup_2, ZCoordinate=0)
gridtype = StreamFilter(Gate=G, Stream0=pop2d, Stream1=radgrid.Points, Stream2=trigrid.Points, Stream3=hexgrid.Points, Stream4=sqgrid.Points)
pt_2 = Point(pt)
linept_grid = Line(StartPoint=gridtype, EndPoint=pt_2)
G_2 = ClusterInput()
f_x_chooser = StreamFilter(Gate=G_2, Stream0="x/2", Stream1="x", Stream2="x*sin(x)")
len = Length(Curve=linept_grid)
B = ClusterInput()
eval = Evaluate(F=f_x_chooser, x=len)
scaledown = Division(A=eval, B=B)
A_3 = ClusterInput()
G_3 = ClusterInput()
outputtype = StreamGate(Stream=gridtype, Gate=G_3)  # -> Target0, Target1
S = ClusterInput()
circle = CircleCNR(Center=outputtype.Target0, Normal=Vector(0, 0, 1), Radius=scaledown)
polygon = Polygon(Plane=outputtype.Target1, Radius=scaledown, Segments=S, FilletRadius=0)  # -> Polygon, Length
rotate = Rotate(Geometry=polygon.Polygon, Angle=A_3, Plane=outputtype.Target1)  # -> Geometry, Transform
merge = Merge(Data1=circle, Data2=rotate.Geometry)
R = ClusterOutput(merge)

# ==== cluster HysteresisEng
data = ClusterInput()
data_2 = Data(data)
lng = ListLength(List=data_2)
rec = DataRecorder(data_2, DataLimit=-10, RecordData=True)
partition = PartitionList(List=rec, Size=lng)
split = SplitTree(Data=partition, Masks=flatten("{?;?}"))  # -> Positive, Negative
flip = FlipMatrix(Data=split.Positive)
series = Series(Start=0, Step=1, Count=lng)
simplify = SimplifyTree(Tree=flip, Front=False)
S = ClusterOutput(series)
index = ClusterInput()
send = ClusterInput()
path = ClusterInput()
crossproduct = PythonScript(currentAlt=simplify, index=index, send=send, path=path)  # -> out, alt, capture, bmp_path; inputs currentAlt: tree
# ---------- crossproduct: Python ----------
import itertools
import json
from System import Guid
import os.path
#The best py library ever

recordedAlts = []

for i in range(currentAlt.BranchCount):
    recordedAlts.append(list(set(currentAlt.Branch(i))))
    
for i in recordedAlts:
    i.sort()
print recordedAlts
#delete the annoying 1st item by pushing to tempList
#tempList = []
#for i in range(len(recordedAlts)):
#    l = list(recordedAlts[i]) #<-- recast as list
#    l.pop(0)
#    tempList.append(l)

#clean recorded alts by removing duplicates

#recordedAlts.sort()
#recordedAltsClean = list(recordedAlts for recordedAlts, _ in itertools.groupby(recordedAlts))


#make product
hystProduct = []

for item in itertools.product(*recordedAlts):
    hystProduct.append(item)
        
#clean hysteresis

#hystProduct.sort()
#hystProductClean = list(hystProduct for hystProduct, _ in itertools.groupby(hystProduct))

if(len(hystProduct)>0):
    i = int(index)%(len(hystProduct))
    alt = list(hystProduct[i])
    


gallery = []

# Find in which indices the parameters of alt occur, and length of that array
#for i in alt:
#    index = recordedAltsClean[i].index(alt[i])
#    print index


#print "Alts rec :", len(recordedAlts)," Alts after cleaning :",len(recordedAltsClean)
print "Product full :", len(hystProduct), " Products ", hystProduct
#print alt

path_dir = 'C:/Users/Arefin/Documents/hysteresis-server/public/json/'
if send:
    myguid = Guid.NewGuid()
    myguid_str = myguid.ToString('D')

    indices =[]
    lengths = []
    for i in range(len(alt)):
        temp = list(recordedAlts[i])
        indices.append(temp.index(alt[i]))
        lengths.append(len(temp))
    filename=myguid_str+".json"
    filename_bmp = myguid_str+".bmp"
    full_path_bmp = os.path.join(path_dir,filename_bmp)
    bmp_path = full_path_bmp
    data = {'uid':myguid_str,'image':'json/'+filename_bmp,'cad_file': path_dir, 'param_indices':indices}
    capture = True
    full_path = os.path.join(path_dir,filename)
    with open(full_path,'w') as outfile:
        json.dump(data, outfile, indent=2)
# ---------- end crossproduct ----------
alt = ClusterOutput(crossproduct.alt)
captureimg = PythonScript(capture=crossproduct.capture, bmp_path=crossproduct.bmp_path)  # -> out
# ---------- captureimg: Python ----------
from scriptcontext import doc
if capture:
    bitmap = doc.Views.ActiveView.CaptureToBitmap(True, True, True)
    bitmap.Save(bmp_path)
# ---------- end captureimg ----------
